# Grasshopper definition Intersect001.gh (Grasshopper 1.0.7)
# Copyright: bernhard muller bijoutiers
# plug-ins: Bifocals

surface_line = SurfaceLine(LimitToFirst=False)  # -> Curves, Points, UVPoints, Normal
line_line = LineLine()  # -> ParamA, ParamB, PointA, PointB
mesh_ray = MeshRay()  # -> Point, Hit
curve_line = CurveLine()  # -> Points, Params, Count
brep_line = BrepLine(LimitToFirst=False)  # -> Curves, Points

xz_plane = XZPlane(Origin=Point(0, 0, 0))
polygon = Polygon(Plane=PlaneXY(0, 0, 0), Radius=3, Segments=6, FilletRadius=0)  # -> Polygon, Length
xz_plane_2 = XZPlane(Origin=Point(0, 0, 0))
rotate_3d = Rotate3D(Geometry=polygon.Polygon, Angle=1.570796327, Center=Point(0, 0, 0), Axis=xz_plane)  # -> Geometry, Transform
circle = Circle(Plane=PlaneXY(0, 0, 0), Radius=Slider(2, range=0..10))
populate_2d = Populate2D(
    Region={Plane=PlaneXY(0, 0, 0), Size=Domain2(u=0..20, v=0..10)},
    Count=Slider(3, range=0..10),
    Seed=Slider(46, range=0..100))
mesh_sphere = MeshSphere(Base=PlaneXY(0, 0, 0), Radius=10, UCount=10, VCount=20)
deconstruct_brep = DeconstructBrep(Brep=polygon.Polygon)  # -> Faces, Edges, Vertices
list_item = ListItem(List=populate_2d, Index=0, Wrap=True)  # -> Item, Item1, Item2
move = Move(Geometry=mesh_sphere, Motion=Vector(0, 0, 10))  # -> Geometry, Transform
populate_2d_2 = Populate2D(Region={Plane=PlaneXY(0, 0, 0), Size=Domain2(u=0..20, v=0..10)}, Count=Slider(81, range=0..100), Seed=1)
unit_x = UnitX(Factor=Slider(3.54, range=0..10))
list_item_2 = ListItem(List=deconstruct_brep.Vertices, Index=0, Wrap=True)  # -> Item, Item1, Item2, Item3, Item4, Item5, Item6, Item7
xz_plane_3 = XZPlane(Origin=Point(0, 0, 0))
_4point_surface = _4PointSurface(CornerA=list_item.Item, CornerB=list_item.Item1, CornerC=list_item.Item2)
area = Area(Geometry=_4point_surface)  # -> Area, Centroid
unit_z = UnitZ(Factor=1)
line = Line(StartPoint=list_item_2.Item, EndPoint=list_item_2.Item4)
point_on_curve = PointOnCurve(line, parameter=0.5)
scale = Scale(Geometry=line, Center=point_on_curve, Factor=Slider(10, range=0..10))  # -> Geometry, Transform
curve = Curve(scale.Geometry)
rotate_3d_2 = Rotate3D(Geometry=_4point_surface, Angle=1.570796327, Center=area.Centroid, Axis=xz_plane_3)  # -> Geometry, Transform
scale_2 = Scale(Geometry=line, Center=point_on_curve, Factor=Slider(2, range=0..10))  # -> Geometry, Transform
curve_2 = Curve(scale_2.Geometry)
point_on_curve_2 = PointOnCurve(curve_2, parameter=0.5)
curve_3 = Curve(scale_2.Geometry)
rotate_3d_3 = Rotate3D(Geometry=curve_2, Angle=1.570796327, Center=point_on_curve_2, Axis=xz_plane_2)  # -> Geometry, Transform
move_2 = Move(Geometry=rotate_3d_3.Geometry, Motion=unit_x)  # -> Geometry, Transform
line_line_2 = LineLine(Line1=curve_2, Line2=move_2.Geometry)  # -> ParamA, ParamB, PointA, PointB
curve_line_2 = CurveLine(Curve=circle, Line=curve_3)  # -> Points, Params, Count
mesh_ray_2 = MeshRay(Mesh=move.Geometry, Point=populate_2d_2, Direction=unit_z)  # -> Point, Hit
surface_line_2 = SurfaceLine(Surface=rotate_3d_2.Geometry, Line=curve, LimitToFirst=False)  # -> Curves, Points, UVPoints, Normal
surface_line_3 = SurfaceLine(Surface=_4point_surface, Line=curve, LimitToFirst=False)  # -> Curves, Points, UVPoints, Normal
brep_line_2 = BrepLine(Brep=polygon.Polygon, Line=scale_2.Geometry, LimitToFirst=False)  # -> Curves, Points
brep_line_3 = BrepLine(Brep=rotate_3d.Geometry, Line=scale_2.Geometry, LimitToFirst=False)  # -> Curves, Points
panel = Panel(curve_line_2.Params)
panel_2 = Panel(line_line_2.ParamB)
panel_3 = Panel(line_line_2.ParamA)
panel_4 = Panel(mesh_ray_2.Hit)
point = Point(line_line_2.PointA)
point_2 = Point(mesh_ray_2.Point)
point_3 = Point(curve_line_2.Points)
point_4 = Point(line_line_2.PointB)
panel_5 = Panel(curve_line_2.Count)
point_5 = Point(surface_line_3.Points)
curve_4 = Curve(surface_line_3.Curves)
point_6 = Point(surface_line_2.Points)
curve_5 = Curve(brep_line_2.Curves)
curve_6 = Curve(surface_line_2.Curves)
point_7 = Point(brep_line_2.Points)
curve_7 = Curve(brep_line_3.Curves)
point_8 = Point(brep_line_3.Points)

contour = Contour(Point=Point(0, 0, 0), Direction=Vector(0, 0, 1))
contour_ex = ContourEx(Plane=PlaneXY(0, 0, 0))
plane_plane_plane = PlanePlanePlane()  # -> Point, LineAB, LineAC, LineBC
line_plane = LinePlane()  # -> Point, ParamL, ParamP
plane_region = PlaneRegion(Plane=PlaneXY(0, 0, 0))
curve_plane = CurvePlane()  # -> Points, ParamsC, ParamsP
mesh_plane = MeshPlane()
plane_plane = PlanePlane()
brep_plane = BrepPlane(Plane=PlaneXY(0, 0, 0))  # -> Curves, Points
isovist_ray = IsoVistRay(Radius=100)  # -> Point, Distance, Index
isovist = IsoVist(Count=10, Radius=100)  # -> Points, Distance, Index
