# Grasshopper definition Intersect001b.gh (Grasshopper 1.0.7)
# Copyright: bernhard muller bijoutiers
# plug-ins: Bifocals

surface_line = SurfaceLine(LimitToFirst=False)  # -> Curves, Points, UVPoints, Normal
line_line = LineLine()  # -> ParamA, ParamB, PointA, PointB
mesh_ray = MeshRay()  # -> Point, Hit
curve_line = CurveLine()  # -> Points, Params, Count
brep_line = BrepLine(LimitToFirst=False)  # -> Curves, Points

xz_plane = XZPlane(Origin=Point(0, 0, 0))
polygon = Polygon(Plane=PlaneXY(0, 0, 0), Radius=3, Segments=6, FilletRadius=0)  # -> Polygon, Length
xz_plane_2 = XZPlane(Origin=Point(0, 0, 0))
rotate_3d = Rotate3D(Geometry=polygon.Polygon, Angle=1.570796327, Center=Point(0, 0, 0), Axis=xz_plane)  # -> Geometry, Transform
circle = Circle(Plane=PlaneXY(0, 0, 0), Radius=Slider(2, range=0..10))
populate_2d = Populate2D(
    Region={Plane=PlaneXY(0, 0, 0), Size=Domain2(u=0..20, v=0..10)},
    Count=Slider(3, range=0..10),
    Seed=Slider(46, range=0..100))
mesh_sphere = MeshSphere(Base=PlaneXY(0, 0, 0), Radius=10, UCount=10, VCount=20)
deconstruct_brep = DeconstructBrep(Brep=polygon.Polygon)  # -> Faces, Edges, Vertices
list_item = ListItem(List=populate_2d, Index=0, Wrap=True)  # -> Item, Item1, Item2
move = Move(Geometry=mesh_sphere, Motion=Vector(0, 0, 10))  # -> Geometry, Transform
populate_2d_2 = Populate2D(Region={Plane=PlaneXY(0, 0, 0), Size=Domain2(u=0..20, v=0..10)}, Count=Slider(81, range=0..100), Seed=1)
unit_x = UnitX(Factor=Slider(3.54, range=0..10))
list_item_2 = ListItem(List=deconstruct_brep.Vertices, Index=0, Wrap=True)  # -> Item, Item1, Item2, Item3, Item4, Item5, Item6, Item7
xz_plane_3 = XZPlane(Origin=Point(0, 0, 0))
_4point_surface = _4PointSurface(CornerA=list_item.Item, CornerB=list_item.Item1, CornerC=list_item.Item2)
area = Area(Geometry=_4point_surface)  # -> Area, Centroid
unit_z = UnitZ(Factor=1)
line = Line(StartPoint=list_item_2.Item, EndPoint=list_item_2.Item4)
point_on_curve = PointOnCurve(line, parameter=0.5)
scale = Scale(Geometry=line, Center=point_on_curve, Factor=Slider(10, range=0..10))  # -> Geometry, Transform
curve = Curve(scale.Geometry)
rotate_3d_2 = Rotate3D(Geometry=_4point_surface, Angle=1.570796327, Center=area.Centroid, Axis=xz_plane_3)  # -> Geometry, Transform
scale_2 = Scale(Geometry=line, Center=point_on_curve, Factor=Slider(2, range=0..10))  # -> Geometry, Transform
curve_2 = Curve(scale_2.Geometry)
point_on_curve_2 = PointOnCurve(curve_2, parameter=0.5)
curve_3 = Curve(scale_2.Geometry)
rotate_3d_3 = Rotate3D(Geometry=curve_2, Angle=1.570796327, Center=point_on_curve_2, Axis=xz_plane_2)  # -> Geometry, Transform
move_2 = Move(Geometry=rotate_3d_3.Geometry, Motion=unit_x)  # -> Geometry, Transform
line_line_2 = LineLine(Line1=curve_2, Line2=move_2.Geometry)  # -> ParamA, ParamB, PointA, PointB
curve_line_2 = CurveLine(Curve=circle, Line=curve_3)  # -> Points, Params, Count
mesh_ray_2 = MeshRay(Mesh=move.Geometry, Point=populate_2d_2, Direction=unit_z)  # -> Point, Hit
surface_line_2 = SurfaceLine(Surface=rotate_3d_2.Geometry, Line=curve, LimitToFirst=False)  # -> Curves, Points, UVPoints, Normal
surface_line_3 = SurfaceLine(Surface=_4point_surface, Line=curve, LimitToFirst=False)  # -> Curves, Points, UVPoints, Normal
brep_line_2 = BrepLine(Brep=polygon.Polygon, Line=scale_2.Geometry, LimitToFirst=False)  # -> Curves, Points
brep_line_3 = BrepLine(Brep=rotate_3d.Geometry, Line=scale_2.Geometry, LimitToFirst=False)  # -> Curves, Points
panel = Panel(curve_line_2.Params)
panel_2 = Panel(line_line_2.ParamB)
panel_3 = Panel(line_line_2.ParamA)
panel_4 = Panel(mesh_ray_2.Hit)
point = Point(line_line_2.PointA)
point_2 = Point(mesh_ray_2.Point)
point_3 = Point(curve_line_2.Points)
point_4 = Point(line_line_2.PointB)
panel_5 = Panel(curve_line_2.Count)
point_5 = Point(surface_line_3.Points)
curve_4 = Curve(surface_line_3.Curves)
point_6 = Point(surface_line_2.Points)
curve_5 = Curve(brep_line_2.Curves)
curve_6 = Curve(surface_line_2.Curves)
point_7 = Point(brep_line_2.Points)
curve_7 = Curve(brep_line_3.Curves)
point_8 = Point(brep_line_3.Points)

# ----
# Really Cool Tool!
number_slider = Slider(697, range=0..1000)
polygon_2 = Polygon(Plane=PlaneXY(0, 0, 0), Radius=3, Segments=6, FilletRadius=0)  # -> Polygon, Length
populate_2d_3 = Populate2D(Region=polygon_2.Polygon, Count=Slider(14, range=0..20), Seed=number_slider)
number_slider_2 = Slider(100, range=0..100)
construct_plane = ConstructPlane(Origin=Point(0, 0, 0), XAxis=Vector(1, 0, 0), YAxis=Vector(0, 1, 0))
circle_2 = Circle(Plane=populate_2d_3, Radius=1)
isovist = IsoVist(Plane=construct_plane, Count=Slider(11, range=0..100), Radius=number_slider_2, Obstacles=circle_2)  # -> Points, Distance, Index
panel_6 = Panel(isovist.Index)
point_9 = Point(isovist.Points)
panel_7 = Panel(isovist.Distance)
list_length = ListLength(List=point_9)
panel_8 = Panel(point_9)
interpolate = Interpolate(Vertices=isovist.Points, Degree=3, Periodic=True, KnotStyle=1)  # -> Curve, Length, Domain
panel_9 = Panel(list_length)

geometry = Geometry(graft(circle_2))
geometry_2 = Geometry(circle_2)

contour = Contour(Point=Point(0, 0, 0), Direction=Vector(0, 0, 1))
brep_plane = BrepPlane(Plane=PlaneXY(0, 0, 0))  # -> Curves, Points
contour_ex = ContourEx(Plane=PlaneXY(0, 0, 0))
curve_plane = CurvePlane()  # -> Points, ParamsC, ParamsP
isovist_2 = IsoVist(Count=10, Radius=100)  # -> Points, Distance, Index
line_plane = LinePlane()  # -> Point, ParamL, ParamP
mesh_plane = MeshPlane()
plane_region = PlaneRegion(Plane=PlaneXY(0, 0, 0))
plane_plane = PlanePlane()
plane_plane_plane = PlanePlanePlane()  # -> Point, LineAB, LineAC, LineBC
isovist_ray = IsoVistRay(Radius=100)  # -> Point, Distance, Index
construct_plane_2 = ConstructPlane(Origin=Point(0, 0, 0), XAxis=Vector(1, 0, 0), YAxis=Vector(0, 1, 0))
number_slider_3 = Slider(0.39, range=0..1)
cylinder = Cylinder(Base=PlaneXY(0, 0, 0), Radius=0.5, Length=1)
pi = Pi(Factor=Slider(0.25, range=0..2))
xz_plane_4 = XZPlane(Origin=Point(0, 0, 0))
construct_domain = ConstructDomain(DomainStart=0, DomainEnd=Slider(0.81, range=0..2))
unit_z_2 = UnitZ(Factor=1)
construct_point = ConstructPoint(XCoordinate=0, YCoordinate=0, ZCoordinate=0)
cap_holes = CapHoles(Brep=cylinder)
xy_plane = XYPlane(Origin=Point(0, 0, 0))
yz_plane = YZPlane(Origin=Point(0, 0, 0))
rotate_3d_4 = Rotate3D(Geometry=construct_plane_2, Angle=pi, Center=construct_plane_2, Axis=xz_plane_4)  # -> Geometry, Transform
unit_z_3 = UnitZ(Factor=number_slider_3)
range = Range(Domain=construct_domain, Steps=Slider(4, range=0..10))
xz_plane_5 = XZPlane(Origin=Point(0, 0, 0))
construct_plane_3 = ConstructPlane(Origin=Point(0, 0, 0), XAxis=Vector(1, 0, 0), YAxis=Vector(0, 1, 0))
construct_mesh = ConstructMesh(Vertices=[Point(0, 0, 0), Point(10, 0, 0), Point(10, 10, 0), Point(0, 10, 0)], Faces={A=0, B=1, C=2, D=3})
rotate_3d_5 = Rotate3D(Geometry=construct_plane_2, Angle=pi, Center=construct_plane_2, Axis=yz_plane)  # -> Geometry, Transform
unit_x_2 = UnitX(Factor=Slider(3.67, range=0..10))
unit_z_4 = UnitZ(Factor=range)
move_3 = Move(Geometry=xy_plane, Motion=unit_z_3)  # -> Geometry, Transform
rotate_3d_6 = Rotate3D(Geometry=move_3.Geometry, Angle=1.570796327, Center=Point(0, 0, 0), Axis=xz_plane_5)  # -> Geometry, Transform
rotate_3d_7 = Rotate3D(Geometry=move_3.Geometry, Angle=1.570796327, Center=Point(0, 0, 0), Axis=xz_plane_5)  # -> Geometry, Transform
polygon_3 = Polygon(Plane=PlaneXY(0, 0, 0), Radius=Slider(12, range=0..100), Segments=6, FilletRadius=0)  # -> Polygon, Length
move_4 = Move(Geometry=rotate_3d_4.Geometry, Motion=unit_z_4)  # -> Geometry, Transform
move_5 = Move(Geometry=rotate_3d_6.Geometry, Motion=unit_x_2)  # -> Geometry, Transform
curve_8 = Curve(scale_2.Geometry)
end_points = EndPoints(Curve=curve_8)  # -> Start, End
line_2 = Line(StartPoint=end_points.Start, EndPoint=end_points.End)
plane = Plane(construct_plane_3)
plane_2 = Plane(move_5.Geometry)
contour_ex_2 = ContourEx(Shape=cap_holes, Plane=[xy_plane, move_3.Geometry], Distances=number_slider_3)
line_3 = Line(Line((3.50334189, -4.423826923, 0), (-4.395121182, 4.0293035, 0)))
brep_plane_2 = BrepPlane(Brep=cap_holes, Plane=move_4.Geometry)  # -> Curves, Points
unit_x_3 = UnitX(Factor=Slider(3.91, range=0..10))
contour_2 = Contour(Shape=cap_holes, Point=construct_point, Direction=unit_z_2, Distance=Slider(0.29, range=0..1))
panel_10 = Panel(geometry)
plane_3 = Plane(plane_2)
geometry_3 = Geometry(flatten(brep_plane_2.Curves))
panel_11 = Panel(contour_ex_2)
curve_plane_2 = CurvePlane(Curve=curve_8, Plane=rotate_3d_7.Geometry)  # -> Points, ParamsC, ParamsP
line_plane_2 = LinePlane(Line=line_2, Plane=rotate_3d_7.Geometry)  # -> Point, ParamL, ParamP
plane_plane_2 = PlanePlane(PlaneA=construct_plane_3, PlaneB=move_5.Geometry)
move_6 = Move(Geometry=plane_3, Motion=unit_x_3)  # -> Geometry, Transform
mesh_plane_2 = MeshPlane(Mesh=construct_mesh, Plane=move_5.Geometry)
plane_4 = Plane(rotate_3d_5.Geometry)
plane_plane_plane_2 = PlanePlanePlane(PlaneA=plane_2, PlaneB=plane, PlaneC=rotate_3d_5.Geometry)  # -> Point, LineAB, LineAC, LineBC
isovist_ray_2 = IsoVistRay(Sample=line_3, Radius=number_slider_2, Obstacles=geometry)  # -> Point, Distance, Index
list_item_3 = ListItem(List=geometry, Index=0, Wrap=True)  # -> Item, Item1, Item2, Item3
loft = Loft(Curves=geometry_3, Options={Adjust=False, Closed=False, LoftEnds=0, LoftSimp=0, LoftType=0, Rebuild=10, Refit=0.01})
panel_12 = Panel(curve_plane_2.ParamsC)
panel_13 = Panel(line_plane_2.ParamL)
line_4 = Line(plane_plane_plane_2.LineAB)
line_5 = Line(plane_plane_plane_2.LineAC)
line_6 = Line(plane_plane_plane_2.LineBC)
point_10 = Point(plane_plane_plane_2.Point)
point_11 = Point(curve_plane_2.ParamsP)
point_12 = Point(line_plane_2.ParamP)
point_13 = Point(curve_plane_2.Points)
point_14 = Point(line_plane_2.Point)
geometry_4 = Geometry(list_item_3.Item2)
point_15 = Point(isovist_ray_2.Point)
loft_2 = Loft(
    Curves=[line_6, line_5],
    Options={Adjust=False, Closed=False, LoftEnds=0, LoftSimp=0, LoftType=0, Rebuild=10, Refit=0.01})
loft_3 = Loft(
    Curves=[line_4, line_6],
    Options={Adjust=False, Closed=False, LoftEnds=0, LoftSimp=0, LoftType=0, Rebuild=10, Refit=0.01})
line_7 = Line(StartPoint=point_13, EndPoint=point_11)
loft_4 = Loft(
    Curves=[line_4, line_5],
    Options={Adjust=False, Closed=False, LoftEnds=0, LoftSimp=0, LoftType=0, Rebuild=10, Refit=0.01})
panel_14 = Panel(isovist_ray_2.Distance)
plane_region_2 = PlaneRegion(Plane=polygon_3.Polygon, Bounds=[plane_3, move_6.Geometry, plane_4])
panel_15 = Panel(geometry_4)
param_viewer = ParamViewer(isovist_ray_2.Distance)

curve_curve = CurveCurve()  # -> Points, ParamsA, ParamsB
multiple_curves = MultipleCurves()  # -> Points, IndexA, IndexB, ParamA, ParamB
curve_self = CurveSelf()  # -> Points, Params
