# Grasshopper definition Intersect001c.gh (Grasshopper 1.0.7)
# Copyright: bernhard muller bijoutiers
# plug-ins: Bifocals

surface_line = SurfaceLine(LimitToFirst=False)  # -> Curves, Points, UVPoints, Normal; disabled
line_line = LineLine()  # -> ParamA, ParamB, PointA, PointB; disabled
mesh_ray = MeshRay()  # -> Point, Hit; disabled
curve_line = CurveLine()  # -> Points, Params, Count; disabled
brep_line = BrepLine(LimitToFirst=False)  # -> Curves, Points; disabled

number_slider = Slider(46, range=0..100)  # disabled
number_slider_2 = Slider(3, range=0..10)  # disabled
number_slider_3 = Slider(2, range=0..10)  # disabled
xz_plane = XZPlane(Origin=Point(0, 0, 0))  # disabled
polygon = Polygon(Plane=PlaneXY(0, 0, 0), Radius=3, Segments=6, FilletRadius=0)  # -> Polygon, Length; disabled
xz_plane_2 = XZPlane(Origin=Point(0, 0, 0))  # disabled
rotate_3d = Rotate3D(Geometry=polygon.Polygon, Angle=1.570796327, Center=Point(0, 0, 0), Axis=xz_plane)  # -> Geometry, Transform; disabled
number_slider_4 = Slider(10, range=0..10)  # disabled
circle = Circle(Plane=PlaneXY(0, 0, 0), Radius=number_slider_3)  # disabled
number_slider_5 = Slider(81, range=0..100)  # disabled
number_slider_6 = Slider(3.54, range=0..10)  # disabled
populate_2d = Populate2D(Region={Plane=PlaneXY(0, 0, 0), Size=Domain2(u=0..20, v=0..10)}, Count=number_slider_2, Seed=number_slider)  # disabled
mesh_sphere = MeshSphere(Base=PlaneXY(0, 0, 0), Radius=10, UCount=10, VCount=20)  # disabled
deconstruct_brep = DeconstructBrep(Brep=polygon.Polygon)  # -> Faces, Edges, Vertices; disabled
list_item = ListItem(List=populate_2d, Index=0, Wrap=True)  # -> Item, Item1, Item2; disabled
move = Move(Geometry=mesh_sphere, Motion=Vector(0, 0, 10))  # -> Geometry, Transform; disabled
populate_2d_2 = Populate2D(Region={Plane=PlaneXY(0, 0, 0), Size=Domain2(u=0..20, v=0..10)}, Count=number_slider_5, Seed=1)  # disabled
unit_x = UnitX(Factor=number_slider_6)  # disabled
list_item_2 = ListItem(List=deconstruct_brep.Vertices, Index=0, Wrap=True)  # -> Item, Item1, Item2, Item3, Item4, Item5, Item6, Item7; disabled
xz_plane_3 = XZPlane(Origin=Point(0, 0, 0))  # disabled
_4point_surface = _4PointSurface(CornerA=list_item.Item, CornerB=list_item.Item1, CornerC=list_item.Item2)  # disabled
area = Area(Geometry=_4point_surface)  # -> Area, Centroid; disabled
unit_z = UnitZ(Factor=1)  # disabled
line = Line(StartPoint=list_item_2.Item, EndPoint=list_item_2.Item4)  # disabled
number_slider_7 = Slider(2, range=0..10)  # disabled
point_on_curve = PointOnCurve(line, parameter=0.5)  # disabled
scale = Scale(Geometry=line, Center=point_on_curve, Factor=number_slider_4)  # -> Geometry, Transform; disabled
curve = Curve(scale.Geometry)  # disabled
rotate_3d_2 = Rotate3D(Geometry=_4point_surface, Angle=1.570796327, Center=area.Centroid, Axis=xz_plane_3)  # -> Geometry, Transform; disabled
scale_2 = Scale(Geometry=line, Center=point_on_curve, Factor=number_slider_7)  # -> Geometry, Transform; disabled
curve_2 = Curve(scale_2.Geometry)  # disabled
point_on_curve_2 = PointOnCurve(curve_2, parameter=0.5)  # disabled
curve_3 = Curve(scale_2.Geometry)  # disabled
rotate_3d_3 = Rotate3D(Geometry=curve_2, Angle=1.570796327, Center=point_on_curve_2, Axis=xz_plane_2)  # -> Geometry, Transform; disabled
move_2 = Move(Geometry=rotate_3d_3.Geometry, Motion=unit_x)  # -> Geometry, Transform; disabled
line_line_2 = LineLine(Line1=curve_2, Line2=move_2.Geometry)  # -> ParamA, ParamB, PointA, PointB; disabled
curve_line_2 = CurveLine(Curve=circle, Line=curve_3)  # -> Points, Params, Count; disabled
mesh_ray_2 = MeshRay(Mesh=move.Geometry, Point=populate_2d_2, Direction=unit_z)  # -> Point, Hit; disabled
surface_line_2 = SurfaceLine(Surface=rotate_3d_2.Geometry, Line=curve, LimitToFirst=False)  # -> Curves, Points, UVPoints, Normal; disabled
surface_line_3 = SurfaceLine(Surface=_4point_surface, Line=curve, LimitToFirst=False)  # -> Curves, Points, UVPoints, Normal; disabled
brep_line_2 = BrepLine(Brep=polygon.Polygon, Line=scale_2.Geometry, LimitToFirst=False)  # -> Curves, Points; disabled
brep_line_3 = BrepLine(Brep=rotate_3d.Geometry, Line=scale_2.Geometry, LimitToFirst=False)  # -> Curves, Points; disabled
panel = Panel(curve_line_2.Params)  # disabled
panel_2 = Panel(line_line_2.ParamB)  # disabled
panel_3 = Panel(line_line_2.ParamA)  # disabled
panel_4 = Panel(mesh_ray_2.Hit)  # disabled
point = Point(line_line_2.PointA)  # disabled
point_2 = Point(mesh_ray_2.Point)  # disabled
point_3 = Point(curve_line_2.Points)  # disabled
point_4 = Point(line_line_2.PointB)  # disabled
panel_5 = Panel(curve_line_2.Count)  # disabled
point_5 = Point(surface_line_3.Points)  # disabled
curve_4 = Curve(surface_line_3.Curves)  # disabled
point_6 = Point(surface_line_2.Points)  # disabled
curve_5 = Curve(brep_line_2.Curves)  # disabled
curve_6 = Curve(surface_line_2.Curves)  # disabled
point_7 = Point(brep_line_2.Points)  # disabled
curve_7 = Curve(brep_line_3.Curves)  # disabled
point_8 = Point(brep_line_3.Points)  # disabled

# ----
# Really Cool Tool!
number_slider_8 = Slider(697, range=0..1000)  # disabled
number_slider_9 = Slider(14, range=0..20)  # disabled
polygon_2 = Polygon(Plane=PlaneXY(0, 0, 0), Radius=3, Segments=6, FilletRadius=0)  # -> Polygon, Length; disabled
populate_2d_3 = Populate2D(Region=polygon_2.Polygon, Count=number_slider_9, Seed=number_slider_8)  # disabled
number_slider_10 = Slider(100, range=0..100)  # disabled
number_slider_11 = Slider(11, range=0..100)  # disabled
construct_plane = ConstructPlane(Origin=Point(0, 0, 0), XAxis=Vector(1, 0, 0), YAxis=Vector(0, 1, 0))  # disabled
circle_2 = Circle(Plane=populate_2d_3, Radius=1)  # disabled
isovist = IsoVist(Plane=construct_plane, Count=number_slider_11, Radius=number_slider_10, Obstacles=circle_2)  # -> Points, Distance, Index; disabled
panel_6 = Panel(isovist.Index)  # disabled
point_9 = Point(isovist.Points)  # disabled
panel_7 = Panel(isovist.Distance)  # disabled
list_length = ListLength(List=point_9)  # disabled
panel_8 = Panel(point_9)  # disabled
interpolate = Interpolate(Vertices=isovist.Points, Degree=3, Periodic=True, KnotStyle=1)  # -> Curve, Length, Domain; disabled
panel_9 = Panel(list_length)  # disabled

vertices = Vertices([Point(0, 0, 0), Point(10, 0, 0), Point(10, 10, 0), Point(0, 10, 0)])  # disabled
origin = Origin(Point(0, 0, 0))  # disabled

geometry = Geometry(graft(circle_2))  # disabled
geometry_2 = Geometry(circle_2)  # disabled

contour = Contour(Point=Point(0, 0, 0), Direction=Vector(0, 0, 1))  # disabled
brep_plane = BrepPlane(Plane=PlaneXY(0, 0, 0))  # -> Curves, Points; disabled
contour_ex = ContourEx(Plane=PlaneXY(0, 0, 0))  # disabled
curve_plane = CurvePlane()  # -> Points, ParamsC, ParamsP; disabled
isovist_2 = IsoVist(Count=10, Radius=100)  # -> Points, Distance, Index; disabled
line_plane = LinePlane()  # -> Point, ParamL, ParamP; disabled
mesh_plane = MeshPlane()  # disabled
plane_region = PlaneRegion(Plane=PlaneXY(0, 0, 0))  # disabled
plane_plane = PlanePlane()  # disabled
plane_plane_plane = PlanePlanePlane()  # -> Point, LineAB, LineAC, LineBC; disabled
isovist_ray = IsoVistRay(Radius=100)  # -> Point, Distance, Index; disabled
number_slider_12 = Slider(0.81, range=0..2)  # disabled
number_slider_13 = Slider(4, range=0..10)  # disabled
number_slider_14 = Slider(0.25, range=0..2)  # disabled
construct_plane_2 = ConstructPlane(Origin=Point(0, 0, 0), XAxis=Vector(1, 0, 0), YAxis=Vector(0, 1, 0))  # disabled
number_slider_15 = Slider(0.39, range=0..1)  # disabled
cylinder = Cylinder(Base=PlaneXY(0, 0, 0), Radius=0.5, Length=1)  # disabled
pi = Pi(Factor=number_slider_14)  # disabled
xz_plane_4 = XZPlane(Origin=Point(0, 0, 0))  # disabled
number_slider_16 = Slider(0.29, range=0..1)  # disabled
construct_domain = ConstructDomain(DomainStart=0, DomainEnd=number_slider_12)  # disabled
unit_z_2 = UnitZ(Factor=1)  # disabled
construct_point = ConstructPoint(XCoordinate=0, YCoordinate=0, ZCoordinate=0)  # disabled
number_slider_17 = Slider(3.67, range=0..10)  # disabled
cap_holes = CapHoles(Brep=cylinder)  # disabled
xy_plane = XYPlane(Origin=Point(0, 0, 0))  # disabled
yz_plane = YZPlane(Origin=Point(0, 0, 0))  # disabled
rotate_3d_4 = Rotate3D(Geometry=construct_plane_2, Angle=pi, Center=construct_plane_2, Axis=xz_plane_4)  # -> Geometry, Transform; disabled
unit_z_3 = UnitZ(Factor=number_slider_15)  # disabled
range = Range(Domain=construct_domain, Steps=number_slider_13)  # disabled
xz_plane_5 = XZPlane(Origin=Point(0, 0, 0))  # disabled
number_slider_18 = Slider(12, range=0..100)  # disabled
construct_mesh = ConstructMesh(Vertices=vertices, Faces={A=0, B=1, C=2, D=3})  # disabled
construct_plane_3 = ConstructPlane(Origin=origin, XAxis=Vector(1, 0, 0), YAxis=Vector(0, 1, 0))  # disabled
rotate_3d_5 = Rotate3D(Geometry=construct_plane_2, Angle=pi, Center=construct_plane_2, Axis=yz_plane)  # -> Geometry, Transform; disabled
unit_x_2 = UnitX(Factor=number_slider_17)  # disabled
unit_z_4 = UnitZ(Factor=range)  # disabled
move_3 = Move(Geometry=xy_plane, Motion=unit_z_3)  # -> Geometry, Transform; disabled
rotate_3d_6 = Rotate3D(Geometry=move_3.Geometry, Angle=1.570796327, Center=Point(0, 0, 0), Axis=xz_plane_5)  # -> Geometry, Transform; disabled
rotate_3d_7 = Rotate3D(Geometry=move_3.Geometry, Angle=1.570796327, Center=Point(0, 0, 0), Axis=xz_plane_5)  # -> Geometry, Transform; disabled
polygon_3 = Polygon(Plane=PlaneXY(0, 0, 0), Radius=number_slider_18, Segments=6, FilletRadius=0)  # -> Polygon, Length; disabled
number_slider_19 = Slider(3.91, range=0..10)  # disabled
move_4 = Move(Geometry=rotate_3d_4.Geometry, Motion=unit_z_4)  # -> Geometry, Transform; disabled
move_5 = Move(Geometry=rotate_3d_6.Geometry, Motion=unit_x_2)  # -> Geometry, Transform; disabled
curve_8 = Curve(scale_2.Geometry)  # disabled
end_points = EndPoints(Curve=curve_8)  # -> Start, End; disabled
line_2 = Line(StartPoint=end_points.Start, EndPoint=end_points.End)  # disabled
plane = Plane(construct_plane_3)  # disabled
plane_2 = Plane(move_5.Geometry)  # disabled
contour_ex_2 = ContourEx(Shape=cap_holes, Plane=[xy_plane, move_3.Geometry], Distances=number_slider_15)  # disabled
line_3 = Line(Line((3.50334189, -4.423826923, 0), (-4.395121182, 4.0293035, 0)))  # disabled
brep_plane_2 = BrepPlane(Brep=cap_holes, Plane=move_4.Geometry)  # -> Curves, Points; disabled
unit_x_3 = UnitX(Factor=number_slider_19)  # disabled
contour_2 = Contour(Shape=cap_holes, Point=construct_point, Direction=unit_z_2, Distance=number_slider_16)  # disabled
panel_10 = Panel(geometry)  # disabled
plane_3 = Plane(plane_2)  # disabled
geometry_3 = Geometry(flatten(brep_plane_2.Curves))  # disabled
panel_11 = Panel(contour_ex_2)  # disabled
curve_plane_2 = CurvePlane(Curve=curve_8, Plane=rotate_3d_7.Geometry)  # -> Points, ParamsC, ParamsP; disabled
line_plane_2 = LinePlane(Line=line_2, Plane=rotate_3d_7.Geometry)  # -> Point, ParamL, ParamP; disabled
plane_plane_2 = PlanePlane(PlaneA=construct_plane_3, PlaneB=move_5.Geometry)  # disabled
move_6 = Move(Geometry=plane_3, Motion=unit_x_3)  # -> Geometry, Transform; disabled
mesh_plane_2 = MeshPlane(Mesh=construct_mesh, Plane=move_5.Geometry)  # disabled
plane_4 = Plane(rotate_3d_5.Geometry)  # disabled
plane_plane_plane_2 = PlanePlanePlane(PlaneA=plane_2, PlaneB=plane, PlaneC=rotate_3d_5.Geometry)  # -> Point, LineAB, LineAC, LineBC; disabled
isovist_ray_2 = IsoVistRay(Sample=line_3, Radius=number_slider_10, Obstacles=geometry)  # -> Point, Distance, Index; disabled
list_item_3 = ListItem(List=geometry, Index=0, Wrap=True)  # -> Item, Item1, Item2, Item3; disabled
loft = Loft(Curves=geometry_3, Options={Adjust=False, Closed=False, LoftEnds=0, LoftSimp=0, LoftType=0, Rebuild=10, Refit=0.01})  # disabled
panel_12 = Panel(curve_plane_2.ParamsC)  # disabled
panel_13 = Panel(line_plane_2.ParamL)  # disabled
line_4 = Line(plane_plane_plane_2.LineAB)  # disabled
line_5 = Line(plane_plane_plane_2.LineAC)  # disabled
line_6 = Line(plane_plane_plane_2.LineBC)  # disabled
point_10 = Point(plane_plane_plane_2.Point)  # disabled
point_11 = Point(curve_plane_2.ParamsP)  # disabled
point_12 = Point(line_plane_2.ParamP)  # disabled
point_13 = Point(curve_plane_2.Points)  # disabled
point_14 = Point(line_plane_2.Point)  # disabled
geometry_4 = Geometry(list_item_3.Item2)  # disabled
point_15 = Point(isovist_ray_2.Point)  # disabled
loft_2 = Loft(
    Curves=[line_6, line_5],
    Options={Adjust=False, Closed=False, LoftEnds=0, LoftSimp=0, LoftType=0, Rebuild=10, Refit=0.01})  # disabled
loft_3 = Loft(
    Curves=[line_4, line_6],
    Options={Adjust=False, Closed=False, LoftEnds=0, LoftSimp=0, LoftType=0, Rebuild=10, Refit=0.01})  # disabled
line_7 = Line(StartPoint=point_13, EndPoint=point_11)  # disabled
loft_4 = Loft(
    Curves=[line_4, line_5],
    Options={Adjust=False, Closed=False, LoftEnds=0, LoftSimp=0, LoftType=0, Rebuild=10, Refit=0.01})  # disabled
panel_14 = Panel(isovist_ray_2.Distance)  # disabled
plane_region_2 = PlaneRegion(Plane=polygon_3.Polygon, Bounds=[plane_3, move_6.Geometry, plane_4])  # disabled
panel_15 = Panel(geometry_4)  # disabled
param_viewer = ParamViewer(isovist_ray_2.Distance)  # disabled

curve_curve = CurveCurve()  # -> Points, ParamsA, ParamsB; disabled
multiple_curves = MultipleCurves()  # -> Points, IndexA, IndexB, ParamA, ParamB; disabled
curve_self = CurveSelf()  # -> Points, Params; disabled
number_slider_20 = Slider(2, range=0..10)  # disabled
number_slider_21 = Slider(10, range=0..10)  # disabled
number_slider_22 = Slider(6, range=5..24)  # disabled
circle_3 = Circle(Plane=PlaneXY(0, 0, 0), Radius=1)  # disabled
circle_4 = Circle(Plane=PlaneXY(0, 0, 0), Radius=number_slider_20)  # disabled
unit_x_4 = UnitX(Factor=number_slider_20)  # disabled
range_2 = Range(Domain=number_slider_21, Steps=number_slider_22)  # disabled
unit_x_5 = UnitX(Factor=range_2)  # disabled
move_7 = Move(Geometry=circle_4, Motion=unit_x_4)  # -> Geometry, Transform; disabled
move_8 = Move(Geometry=circle_3, Motion=unit_x_5)  # -> Geometry, Transform; disabled
multiple_curves_2 = MultipleCurves(Curves=move_8.Geometry)  # -> Points, IndexA, IndexB, ParamA, ParamB; disabled
curve_9 = Curve(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)  # disabled
curve_curve_2 = CurveCurve(CurveA=circle_4, CurveB=move_7.Geometry)  # -> Points, ParamsA, ParamsB; disabled
point_16 = Point(multiple_curves_2.Points)  # disabled
curve_self_2 = CurveSelf(Curve=curve_9)  # -> Points, Params; disabled
panel_16 = Panel(multiple_curves_2.ParamB)  # disabled
panel_17 = Panel(multiple_curves_2.IndexB)  # disabled
point_17 = Point(curve_self_2.Points)  # disabled
panel_18 = Panel(curve_self_2.Params)  # disabled
sort_list = SortList(Keys=point_16, ValuesA=point_16)  # -> Keys, ValuesA; disabled
panel_19 = Panel(curve_curve_2.ParamsA)  # disabled
panel_20 = Panel(curve_curve_2.ParamsB)  # disabled
point_18 = Point(curve_curve_2.Points)  # disabled
interpolate_2 = Interpolate(Vertices=point_16, Degree=3, Periodic=False, KnotStyle=1)  # -> Curve, Length, Domain; disabled
interpolate_3 = Interpolate(Vertices=sort_list.ValuesA, Degree=3, Periodic=False, KnotStyle=1)  # -> Curve, Length, Domain; disabled
move_9 = Move(Geometry=interpolate_3.Curve, Motion=Vector(0, 0, 10))  # -> Geometry, Transform; disabled
loft_5 = Loft(
    Curves=[interpolate_2.Curve, move_9.Geometry],
    Options={Adjust=False, Closed=False, LoftEnds=0, LoftSimp=0, LoftType=0, Rebuild=10, Refit=0.01})  # disabled

surface_curve = SurfaceCurve()  # -> Curves, Points, UVPoints, Normals, Parameters, Tangents
surface_split = SurfaceSplit()
brep_brep = BrepBrep()  # -> Curves, Points
brep_curve = BrepCurve()  # -> Curves, Points
number_slider_23 = Slider(2, range=0..10)
construct_domain_2 = ConstructDomain(DomainStart=0, DomainEnd=Slider(2, range=0..10))
plane_surface = PlaneSurface(Plane=PlaneXY(0, 0, 0), XSize=Domain(-10, 10), YSize=Domain(-10, 10))
range_3 = Range(Domain=construct_domain_2, Steps=10)
unit_y = UnitY(Factor=Slider(3, range=0..10))
polygon_4 = Polygon(Plane=PlaneXY(0, 0, 0), Radius=3, Segments=6, FilletRadius=0)  # -> Polygon, Length
cylinder_2 = Cylinder(Base=PlaneXY(0, 0, 0), Radius=number_slider_23, Length=number_slider_23)
xz_plane_6 = XZPlane(Origin=Point(0, 0, 0))
sphere = Sphere(Base=PlaneXY(0, 0, 0), Radius=number_slider_23)
circle_5 = Circle(Plane=PlaneXY(0, 0, 0), Radius=number_slider_23)
expression = Expression(x=range_3, Expression="sin(x)")
expression_2 = Expression(x=range_3, Expression="x-1")
cosine = Cosine(Value=range_3)
rotate = Rotate(Geometry=plane_surface, Angle=1.570796327, Plane=xz_plane_6)  # -> Geometry, Transform
negative = Negative(Value=unit_y)
line_8 = Line(Line((-3.782192408, -0.04483536496, 0), (3.366614573, 0, 2.79382803)))
construct_point_2 = ConstructPoint(XCoordinate=expression_2, YCoordinate=expression, ZCoordinate=cosine)
boundary_surfaces = BoundarySurfaces(Edges=polygon_4.Polygon)
construct_point_3 = ConstructPoint(XCoordinate=expression, YCoordinate=expression_2, ZCoordinate=cosine)
boundary_surfaces_2 = BoundarySurfaces(Edges=circle_5)
cap_holes_2 = CapHoles(Brep=cylinder_2)
interpolate_4 = Interpolate(Vertices=construct_point_2, Degree=3, Periodic=False, KnotStyle=1)  # -> Curve, Length, Domain
curve_10 = Curve(interpolate_4.Curve)
extrude = Extrude(Base=curve_10, Direction=[unit_y, negative])
interpolate_5 = Interpolate(Vertices=construct_point_3, Degree=3, Periodic=False, KnotStyle=1)  # -> Curve, Length, Domain
polar_array = PolarArray(Geometry=interpolate_4.Curve, Plane=PlaneXY(0, 0, 0), Count=Slider(8, range=0..10), Angle=6.283185307)  # -> Geometry, Transform
surface_split_2 = SurfaceSplit(Surface=extrude, Curves=interpolate_5.Curve)  # -> flatten(Fragments)
brep_brep_2 = BrepBrep(BrepA=boundary_surfaces_2, BrepB=boundary_surfaces)  # -> Curves, Points
brep_brep_3 = BrepBrep(BrepA=cap_holes_2, BrepB=sphere)  # -> Curves, Points
surface_curve_2 = SurfaceCurve(Surface=rotate.Geometry, Curve=polar_array.Geometry)  # -> Curves, Points, UVPoints, Normals, Parameters, Tangents
brep_curve_2 = BrepCurve(Brep=cap_holes_2, Curve=line_8)  # -> Curves, Points
dispatch = Dispatch(List=surface_split_2, DispatchPattern=[True, False])  # -> ListA, ListB
curve_11 = Curve(brep_curve_2.Curves)
point_19 = Point(brep_curve_2.Points)
curve_12 = Curve(brep_brep_2.Curves)
point_20 = Point(brep_brep_2.Points)
curve_13 = Curve(brep_brep_3.Curves)
point_21 = Point(brep_brep_3.Points)
point_22 = Point(surface_curve_2.UVPoints)
curve_14 = Curve(surface_curve_2.Curves)
vector = Vector(surface_curve_2.Normals)
vector_2 = Vector(surface_curve_2.Tangents)
point_23 = Point(surface_curve_2.Points)
surface = Surface(dispatch.ListA)
surface_2 = Surface(dispatch.ListB)
param_viewer_2 = ParamViewer(surface_curve_2.Parameters)
panel_21 = Panel(surface_curve_2.Parameters)
panel_22 = Panel(vector_2)
clash = Clash(Distance=1, ResultLimit=100)  # -> ClashCount, ClashPoints, ClashRadii, FirstIndex, SecondIndex
mesh_mesh = MeshMesh()
collision_one_many = CollisionOneMany()  # -> Collision, Index
collision_many_many = CollisionManyMany()  # -> Collision, Indices
mesh_curve = MeshCurve()  # -> Points, Faces
